# Grasshopper definition path_planning.ghx (Grasshopper 1.0.7)
# plug-ins: Telepathy

bang = Button()

load_3d_scan = BooleanToggle(False)
set_up_planning_scene = Button()
load_3d_scan_2 = RemoteSender(load_3d_scan)

# ----
# Path planning pipeline
clear_all_planned_paths = Button()
python = GhPythonScript(clear_planned_paths=clear_all_planned_paths)  # -> out; inputs clear_planned_paths: Boolean
# ---------- python: Python ----------
from scriptcontext import sticky

doc = ghenv.Component.OnPingDocument()

if clear_planned_paths:
    for key in sticky.keys():
        print(key)
        if key.startswith("ppl_pipeline"):
            print(sticky[key])
            sticky[key] = None
    for guid in sticky["ppl_components"]:
        comp = doc.FindComponent(guid)
        comp.ExpireSolution(True)
# ---------- end python ----------

connect_to_ros = Button()
load_robot_model = Button()

scale_factor_just_placed_cylinders = Slider(1.1, range=0..10)
constraint_tolerance_joints = Slider(1, range=0..10)
constraint_tolerance_joint6 = Slider(45, range=0..100)
scale_factor_for_collision_meshes_repres = Slider(1.1, range=0..10)  # "Scale factor for collision meshes representing previously placed cylinders"
scale_factor_just_placed_cylinders_2 = RemoteSender(scale_factor_just_placed_cylinders)
constraint_tolerance_joints1_5 = RemoteSender(constraint_tolerance_joints)
constraint_tolerance_joint6_2 = RemoteSender(constraint_tolerance_joint6)
prev_cylinders_scale_factor = RemoteSender(scale_factor_for_collision_meshes_repres)

unload = PythonScript(bang=bang, module="bf3dp_fab")
# ---------- unload: Python ----------
import sys

def unload_modules(top_level_module_name):
    """Unloads all modules named starting with the specified string.

    This function eases the development workflow when editing a library that is
    used from Rhino/Grasshopper.

    Args:
        top_level_module_name (:obj:`str`): Name of the top-level module to unload.

    Returns:
        list: List of unloaded module names.
    """
    modules = filter(lambda m: m.startswith(top_level_module_name), sys.modules)

    for module in modules:
        sys.modules.pop(module)

    return modules

unload_modules(module)
# ---------- end unload ----------
boolean_toggle = BooleanToggle(True)
ros_connect = ROSConnect(port="9090", connect=boolean_toggle)  # -> ros_client, is_connected; inputs port: Int32, connect: Boolean
#   port ip: The ip address ROS. Defaults to 127.0.0.1.
#   port port: The port of ROS. Defaults to 9090.
#   port connect: If True, connects to ROS. If False, disconnects from ROS. Defaults to False.
#   port ros_client: The ROS client.
#   port is_connected: True if connection established.
# ---------- ros_connect: Python ----------
"""
Connect or disconnect to ROS.

COMPAS FAB v0.28.0
"""
from ghpythonlib.componentbase import executingcomponent as component
from scriptcontext import sticky as st

from compas_fab.backends import RosClient
from compas_fab.ghpython.components import create_id


class ROSConnect(component):
    def RunScript(self, ip, port, connect):
        ros_client = None

        ip = ip or "127.0.0.1"
        port = port or 9090

        key = create_id(self, "ros_client")
        ros_client = st.get(key, None)

        if ros_client:
            st[key].close()
        if connect:
            st[key] = RosClient(ip, port)
            st[key].run(5)

        ros_client = st.get(key, None)
        is_connected = ros_client.is_connected if ros_client else False
        return (ros_client, is_connected)
# ---------- end ros_connect ----------

# ---- group: t_A057_ClayTool02_coll_mesh
mesh = Mesh(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)

# ----
acm = RemoteReceiver()

# ----
# Robot model
# Planning scene
units = ValueList({"m": 1, "cm": 100, "mm": 1000}, selected="mm")
load_planning_scene = RemoteReceiver()
create = PythonScript(scale_factor=units, load=load_robot_model, acm=acm)  # -> robot; inputs acm: list, port: Int32
# ---------- create: Python ----------
from scriptcontext import sticky as st


import compas
from compas_fab.backends import RosClient
from compas_fab.robots import PlanningScene
from compas_fab.ghpython import RobotArtist

compas.PRECISION = '12f'

# store robot in component
guid = str(ghenv.Component.InstanceGuid)
robot_key = "robot_" + guid
acm_key = "acm_" + guid

if robot_key not in st:
    st[robot_key] = None

if load:
    with RosClient('127.0.0.1', port) as ros:
        robot = ros.load_robot(load_geometry=True)
        robot.artist = RobotArtist(robot.model)

        robot.scale(scale_factor)
        st[robot_key] = robot

robot = st[robot_key]
scene = None
if robot:

    if tool:
        # Scaled in tool setup nodes
        touch_links = [l.name for l in robot.model.iter_link_chain()][-2:]
        robot.attach_tool(tool, touch_links=touch_links)

        # If a client is connected, we need to update the planning scene accordingly
        if robot.client:
            scene = PlanningScene(robot)
            scene.add_attached_tool()
    else:
        if robot.attached_tool:
            id = robot.attached_tool.name

            # If a client is connected, we need to update the planning scene accordingly
            if robot.client:
                scene.remove_attached_tool()
                scene.remove_collision_mesh(id)
            robot.detach_tool()

if robot and robot.client and load:
    scene = PlanningScene(robot)
    acm_ids = st.get(acm_key)
    if acm_ids:
        # tool is left of this operation since it is never added to st[acm_key]
        removed_acm_ids = set(acm_ids) - set([acm_mesh.collision_mesh.id for acm_mesh in acm])
        if removed_acm_ids:
            for id in acm_ids:
                scene.remove_attached_collision_mesh(id)

            print('Removing old CMs')
            print('Remove: ' + str(acm_ids))
            st[acm_key] = [id for id in acm_ids if id not in removed_acm_ids]

    if len(acm) > 0:
        for mesh in acm:
            scene.add_attached_collision_mesh(mesh)
            st[acm_key].append(mesh.collision_mesh.id)
# ---------- end create ----------

ros_robot = ROSRobot(ros_client=ros_connect.ros_client, load=boolean_toggle)  # -> robot; inputs load: Boolean
#   port ros_client: The ROS client.
#   port load: If True, loads the robot from ROS. Defaults to False.
# ---------- ros_robot: Python ----------
"""
Load robot directly from ROS.

COMPAS FAB v0.28.0
"""
from compas_ghpython.artists import RobotModelArtist
from ghpythonlib.componentbase import executingcomponent as component
from scriptcontext import sticky as st

from compas_fab.ghpython.components import create_id


class ROSRobot(component):
    def RunScript(self, ros_client, load):
        key = create_id(self, "robot")

        if ros_client and ros_client.is_connected and load:
            # Load URDF from ROS
            st[key] = ros_client.load_robot(load_geometry=True, precision="12f")
            st[key].artist = RobotModelArtist(st[key].model)

        robot = st.get(key, None)
        if robot:  # client sometimes need to be restarted, without needing to reload geometry
            robot.client = ros_client
        return robot
# ---------- end ros_robot ----------
scale = Scale(Geometry=mesh, Center=Point(0, 0, 0), Factor=Slider(0.001, range=0..0.001))  # -> Geometry, Transform

# ----
# Tool setup
pln = Plane(PlaneXY(0, 0, 354))
mjoin = MeshJoin(Meshes=flatten(scale.Geometry))

panel = Panel(ros_connect.is_connected)
robot = RemoteSender(create)
set = PythonScript(robot=create, client=ros_connect.ros_client)  # -> out
# ---------- set: Python ----------
if robot and client:
    robot.client = client
    print("Ok!")
else:
    print("Load robot model.")
# ---------- end set ----------

# ----
# Info
info = PythonScript(robot=create)  # -> out, main_group_name
# ---------- info: Python ----------
if robot:
    robot.info()
    main_group_name = robot.main_group_name
# ---------- end info ----------
panel_2 = Panel(info.out)

panel_3 = Panel(set)
scale_2 = Scale(Geometry=pln, Center=Point(0, 0, 0), Factor=Slider(0.001, range=0..0.001))  # -> Geometry, Transform
main_planning_group = RemoteSender(info.main_group_name)
attached_tool = AttachedTool(robot=ros_robot, visual_mesh=mjoin, collision_mesh=mjoin, tcf_plane=scale_2.Geometry)  # -> robot; inputs visual_mesh: Mesh, collision_mesh: Mesh
#   port visual_mesh: A visual mesh for the tool.
#   port collision_mesh: A collision mesh for the tool.
#   port tcf_plane: The frame of the tool in tool0 frame.
#   port group: The planning group to which the tool should be attached.
# ---------- attached_tool: Python ----------
"""
Attach a tool to the robot.

COMPAS FAB v0.28.0
"""
from ghpythonlib.componentbase import executingcomponent as component
from compas_rhino.conversions import RhinoMesh
from compas_rhino.conversions import plane_to_compas_frame

from compas.geometry import Frame
from compas_fab.robots import Tool


class AttachToolComponent(component):
    def RunScript(self, robot, visual_mesh, collision_mesh, tcf_plane, group):
        if robot and robot.client and robot.client.is_connected and visual_mesh:
            if not collision_mesh:
                collision_mesh = visual_mesh

            c_visual_mesh = RhinoMesh.from_geometry(visual_mesh).to_compas()
            c_collision_mesh = RhinoMesh.from_geometry(collision_mesh).to_compas()

            if not tcf_plane:
                frame = Frame.worldXY()
            else:
                frame = plane_to_compas_frame(tcf_plane)
            tool = Tool(c_visual_mesh, frame, c_collision_mesh)

            robot.attach_tool(tool, group)

        return robot
# ---------- end attached_tool ----------

# ---- group: DEBUG CULL, REMOVE LATER
data = Data([0, 3, 4, 5, 6, 8, 10, 11, 14, 17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])

# ----
planning_scene = PlanningScene(robot=attached_tool)  # -> scene
#   port scene: A planning scene.
# ---------- planning_scene: Python ----------
"""
Create a planning scene.

COMPAS FAB v0.28.0
"""
from ghpythonlib.componentbase import executingcomponent as component
from scriptcontext import sticky as st

from compas_fab.ghpython.components import create_id
from compas_fab.robots import PlanningScene


class PlanningSceneComponent(component):
    def RunScript(self, robot):
        key = create_id(self, "planning_scene")
        if robot:
            st[key] = PlanningScene(robot)
        return st.get(key, None)
# ---------- end planning_scene ----------
# Reset scene
reset_scene = GhPythonScript(scene=planning_scene, reset=Button())  # -> out
# ---------- reset_scene: Python ----------
if scene and reset:
    scene.reset()
# ---------- end reset_scene ----------

# ----
# Path constraints
python_2 = GhPythonScript(robot=attached_tool)  # -> out, joint_constraints
# ---------- python_2: Python ----------
from math import radians
from compas_fab.robots import JointConstraint
joint_constraints = []
#joint_constraints.append(JointConstraint("joint_1", radians(-90),
#                      tolerance_below=radians(90),
#                      tolerance_above=radians(100)))

#joint_constraints.append(JointConstraint("joint_3", radians(0),
#                      tolerance_below=radians(90),
#                      tolerance_above=radians(90)))

joint_constraints.append(JointConstraint("joint_4", radians(0),
                      tolerance_below=radians(180),
                      tolerance_above=radians(180)))
joint_constraints.append(JointConstraint("joint_6",
                                         radians(-90),
                                         tolerance_below=radians(200),
                                         tolerance_above=radians(200)))
# ---------- end python_2 ----------
path_constraints = RemoteSender(flatten(python_2.joint_constraints))

construct_point = ConstructPoint(XCoordinate=Slider(0.7, range=-2..2), YCoordinate=Slider(0, range=-2..2), ZCoordinate=Slider(0.6, range=-2..2))
radians = Radians(Degrees=Slider(0, range=-180..180))
radians_2 = Radians(Degrees=Slider(0, range=-180..180))
radians_3 = Radians(Degrees=Slider(0, range=-180..180))
scale_factor_just_placed_cylinders_3 = RemoteReceiver(scale_factor_just_placed_cylinders_2)

# ----
# Configuration
a1 = Slider(0, range=-360..360)
a2 = Slider(0, range=-360..360)
a3 = Slider(0, range=-360..360)
a4 = Slider(0, range=-360..360)
a5 = Slider(30, range=-360..360)
a6 = Slider(180, range=-360..360)
forward_kinematics = PythonScript(robot=attached_tool, a1=a1, a2=a2, a3=a3, a4=a4, a5=a5, a6=a6)  # -> configuration
# ---------- forward_kinematics: Python ----------
import math
from compas_fab.robots import Configuration

if robot:
    joint_positions = [a1, a2, a3, a4, a5, a6]
    joint_positions = [math.radians(a) for a in joint_positions]
    types = robot.get_configurable_joint_types(group)
    configuration = Configuration(joint_positions, types)
    print configuration
# ---------- end forward_kinematics ----------

number_slider = Slider(0.8, range=0..1)

# ----
# Configuration
a1_2 = Slider(0, range=-360..360)
a3_2 = Slider(11, range=-360..360)
a6_2 = Slider(0, range=-360..360)
a2_2 = Slider(0, range=-360..360)
a4_2 = Slider(0, range=-360..360)
a5_2 = Slider(-2, range=-360..360)
forward_kinematics_2 = PythonScript(robot=attached_tool, a1=a1_2, a2=a2_2, a3=a3_2, a4=a4_2, a5=a5_2, a6=a6_2)  # -> configuration; same code as forward_kinematics

construct_point_2 = ConstructPoint(XCoordinate=number_slider, YCoordinate=0, ZCoordinate=number_slider)
point = Point(Point(0, 0, 0))
point_2 = Point(<point referenced from the Rhino model>)
vector_2pt = Vector2Pt(PointA=point, PointB=construct_point_2, Unitize=False)  # -> Vector, Length
flip_plane = FlipPlane(Plane=point_2, ReverseX=False, ReverseY=False, SwapAxes=True)
forward_kinematics_3 = ForwardKinematics(robot=attached_tool, config=forward_kinematics_2)  # -> frame; inputs use_only_model: Boolean
#   port config: The configuration to calculate the forward kinematics for.
#   port group: The planning group used for calculation. Defaults to the robot's main planning group.
#   port link: The link name to calculate forward kinematics for. Defaults to the robot's end effector.
#   port use_only_model: If True, use only the robot model instead of the connected backend to calculate FK.
#   port frame: The resulting frame.
# ---------- forward_kinematics_3: Python ----------
"""
Calculate the robot's forward kinematic for a given configuration.

COMPAS FAB v0.28.0
"""
from ghpythonlib.componentbase import executingcomponent as component


class ForwardKinematics(component):
    def RunScript(self, robot, config, group, link, use_only_model):
        frame = None
        if robot and config:
            options = {}
            if link:
                options["link"] = link
            if use_only_model:
                options["solver"] = "model"
            frame = robot.forward_kinematics(config, group, options=options)
        return frame
# ---------- end forward_kinematics_3 ----------

# ----
# Path constraints
data_2 = Data(python_2.joint_constraints)

inverse_kinematics = InverseKinematics(robot=attached_tool, plane=flip_plane, start_configuration=forward_kinematics)  # -> out, configuration
#   port plane: The plane or frame to calculate the inverse kinematic for.
#   port start_configuration: If passed, calculates the inverse such that the joint positions differ the least from the start_configuration. Defaults to the zero configuration.
#   port group: The planning group used for calculation. Defaults to the robot's main planning group.
#   port configuration: The planning group's configuration.
# ---------- inverse_kinematics: Python ----------
"""
Calculate the robot's inverse kinematic for a given plane.

COMPAS FAB v0.28.0
"""
from compas_rhino.conversions import RhinoPlane
from ghpythonlib.componentbase import executingcomponent as component


class InverseKinematics(component):
    def RunScript(self, robot, plane, start_configuration, group):
        configuration = None
        if robot and robot.client and robot.client.is_connected and plane:
            frame = RhinoPlane.from_geometry(plane).to_compas_frame()
            configuration = robot.inverse_kinematics(frame, start_configuration, group)
        return configuration
# ---------- end inverse_kinematics ----------
draw = Draw(cg=forward_kinematics_3)  # -> rg
#   port cg: The COMPAS geometry or datastructure to be drawn.
#   port rg: The Rhino geometry object.
# ---------- draw: Python ----------
"""
Draws COMPAS geometry in Grasshopper.
"""
from ghpythonlib.componentbase import executingcomponent as component

from compas.artists import Artist


class CompasToRhinoGeometry(component):
    def RunScript(self, cg):
        if not cg:
            return None

        return Artist(cg).draw()
# ---------- end draw ----------
boolean_toggle_2 = BooleanToggle(True)
number_slider_2 = Slider(1, range=0..1)
# Forward kinematics
robot_visualize = RobotVisualize(
    robot=attached_tool,
    configuration=inverse_kinematics.configuration,
    show_end_effector_frame=boolean_toggle_2,
    show_cm=boolean_toggle_2)  # -> visual, collision, collision_meshes, attached_meshes, frames, base_frame, ee_frame; inputs show_visual: Boolean, show_collision: Boolean, show_frames: Boolean, show_base_frame: Boolean, show_end_effector_frame: Boolean, show_cm: Boolean, show_acm: Boolean
#   port group: The planning group used for end-effector and base visualization.
#   port configuration: The robot's full configuration.
#   port show_visual: Whether or not to show the robot's visual meshes.
#   port show_collision: Whether or not to show the robot's collision meshes.
#   port show_frames: Whether or not to show the robot's joint frames.
#   port show_base_frame: Whether or not to show the robot's base frame.
#   port show_end_effector_frame: Whether or not to show the robot's end-effector frame.
#   port show_cm: Whether or not to show the collision meshes (if any).
#   port show_acm: Whether or not to show the attached collision meshes (if any).
#   port visual: Rhino meshes of the robot's visual geometry (if any).
#   port collision: Rhino meshes of the robot's collision geometry (if any).
#   port collision_meshes: Rhino meshes of the scene's collision meshes (if any).
#   port attached_meshes: Rhino meshes of the scene's attached collision meshes (if any).
#   port frames: The robot's joint frames as Rhino planes (if any).
#   port base_frame: The robot's base frame as a Rhino plane (if any).
#   port ee_frame: The robot's end-effector frame as a Rhino plane (if any).
# ---------- robot_visualize: Python ----------
"""
Visualizes the robot.

COMPAS FAB v0.28.0
"""
import time

from compas.artists import Artist
from compas.geometry import Frame
from compas.geometry import Transformation
from ghpythonlib.componentbase import executingcomponent as component
from scriptcontext import sticky as st

from compas_fab.ghpython.components import create_id
from compas_fab.robots import PlanningScene


class RobotVisualize(component):
    def RunScript(
        self,
        robot,
        group,
        configuration,
        show_visual,
        show_collision,
        show_frames,
        show_base_frame,
        show_end_effector_frame,
        show_cm,
        show_acm,
    ):
        visual = None
        collision = None
        collision_meshes = None
        attached_meshes = None
        frames = None
        base_frame = None
        ee_frame = None

        if robot:
            show_visual = True if show_visual is None else show_visual
            show_cm = True if show_cm is None else show_cm
            show_acm = True if show_acm is None else show_acm
            configuration = configuration or robot.zero_configuration()

            robot.update(configuration, visual=show_visual, collision=show_collision)
            compas_frames = robot.transformed_frames(configuration, group)

            if show_visual:
                visual = robot.artist.draw_visual()

            if show_collision:
                collision = robot.artist.draw_collision()

            if show_base_frame:
                base_compas_frame = compas_frames[0]
                artist = Artist(base_compas_frame)
                base_frame = artist.draw()

            if show_end_effector_frame:
                ee_compas_frame = robot.forward_kinematics(configuration, group, options=dict(solver="model"))
                artist = Artist(ee_compas_frame)
                ee_frame = artist.draw()

            if show_frames:
                frames = []
                for compas_frame in compas_frames[1:]:
                    artist = Artist(compas_frame)
                    frame = artist.draw()
                    frames.append(frame)

            cached_scene_key = create_id(self, "cached_scene")

            if show_cm or show_acm:
                cached_scene = st.get(cached_scene_key)
                if not cached_scene:
                    cached_scene = {"time": 0}

                # expire cache if the component has not been executed in the last 2 seconds
                # this allows to slide through a list of configurations
                # without triggering refreshes of the scene in the middle of it
                if time.time() - cached_scene["time"] > 2:
                    update_scene = True
                else:
                    update_scene = False

                if update_scene:
                    scene = PlanningScene(robot)
                    scene = robot.client.get_planning_scene()

                if update_scene and show_cm:
                    collision_meshes = []

                    for co in scene.world.collision_objects:
                        header = co.header
                        frame_id = header.frame_id
                        cms = co.to_collision_meshes()

                        for cm in cms:
                            if cm.frame != Frame.worldXY():
                                t = Transformation.from_frame(cm.frame)
                                mesh = cm.mesh.transformed(t)
                            else:
                                mesh = cm.mesh

                            collision_meshes.append(Artist(mesh).draw())

                        cached_scene["cm"] = collision_meshes

                collision_meshes = cached_scene.get("cm", [])

                if update_scene and show_acm:
                    attached_meshes = []

                    for aco in scene.robot_state.attached_collision_objects:
                        for acm in aco.to_attached_collision_meshes():
                            frame_id = aco.object["header"]["frame_id"]
                            frame = robot.forward_kinematics(configuration, options=dict(link=frame_id))
                            t = Transformation.from_frame(frame)

                            # Local CM frame
                            if acm.collision_mesh.frame and acm.collision_mesh.frame != Frame.worldXY():
                                t = t * Transformation.from_frame(acm.collision_mesh.frame)

                            mesh = acm.collision_mesh.mesh.transformed(t)

                            attached_meshes.append(Artist(mesh).draw())

                    cached_scene["acm"] = attached_meshes

                attached_meshes = cached_scene.get("acm", [])

                cached_scene["time"] = time.time()
                st[cached_scene_key] = cached_scene

        return (
            visual,
            collision,
            collision_meshes,
            attached_meshes,
            frames,
            base_frame,
            ee_frame,
        )
# ---------- end robot_visualize ----------
boolean_toggle_3 = BooleanToggle(True)
run_ik_for_entry = Button()
mesh_2 = Mesh(robot_visualize.visual)
mesh_3 = Mesh(robot_visualize.collision_meshes)
plan_motion = PlanMotion()  # -> trajectory; inputs goal_constraints: list, attached_collision_meshes: list, path_constraints: list, compute: Boolean
#   port goal_constraints: The goal to be achieved, defined in a set of constraints. Constraints can be very specific, for example defining value domains for each joint, such that the goal configuration is included, or defining a volume in space, to which a specific robot link (e.g. the end-effector) is required to move to.
#   port start_configuration: The robot's full configuration, i.e. values for all configurable joints of the entire robot, at the starting position. Defaults to the all-zero configuration.
#   port group: The planning group used for calculation. Defaults to the robot's main planning group.
#   port attached_collision_meshes: A list of attached collision meshes to be included for planning.
#   port path_constraints: Optional constraints that can be imposed along the solution path. Note that path calculation won't work if the start_configuration violates these constraints. Defaults to None.
#   port planner_id: The name of the algorithm used for path planning. Defaults to 'RRTConnect'
#   port compute: If True, calculates a trajectory.
#   port trajectory: The calculated trajectory.
# ---------- plan_motion: Python ----------
"""
Calculate a motion path.

COMPAS FAB v0.28.0
"""
from ghpythonlib.componentbase import executingcomponent as component
from scriptcontext import sticky as st

from compas_fab.ghpython.components import create_id


class PlanMotion(component):
    def RunScript(
        self,
        robot,
        goal_constraints,
        start_configuration,
        group,
        attached_collision_meshes,
        path_constraints,
        planner_id,
        compute,
    ):
        key = create_id(self, "trajectory")

        path_constraints = list(path_constraints) if path_constraints else None
        attached_collision_meshes = list(attached_collision_meshes) if attached_collision_meshes else None
        planner_id = str(planner_id) if planner_id else "RRTConnect"

        if (
            robot
            and robot.client
            and robot.client.is_connected
            and start_configuration
            and goal_constraints
            and compute
        ):
            st[key] = robot.plan_motion(
                goal_constraints,
                start_configuration=start_configuration,
                group=group,
                options=dict(
                    attached_collision_meshes=attached_collision_meshes,
                    path_constraints=path_constraints,
                    planner_id=planner_id,
                ),
            )

        trajectory = st.get(key, None)
        return trajectory
# ---------- end plan_motion ----------
button = Button()
acm_2 = RemoteReceiver()
boolean_toggle_4 = BooleanToggle(True)
acm_3 = RemoteReceiver()
acm_4 = RemoteReceiver()
robot_2 = RemoteReceiver(robot)
trajectory_pick_egress_to_segment_egress = RemoteReceiver()
save_ppl_json = RemoteReceiver()
input_json_path = RemoteReceiver()
robot_3 = RemoteReceiver(robot)
main_planning_group_2 = RemoteReceiver(main_planning_group)
robot_4 = RemoteReceiver(robot)
number_slider_3 = Slider(15, range=0..100)
geo = Geometry()

geo_2 = Geometry()
preview = CustomPreview(Geometry=[geo, geo_2])

# ----
# Start conf to place egress
list = ValueList({"RRT", "RRTConnect", "RRT*": "RRTstar", "EST", "PRM": "RPM", "PRM*": "RPMStar", "SPARS"}, selected="RRT*")
plan_segment_egress_to_place_egress = Button()
allowed_planning_time_per_trajectory = Slider(1, range=0..2)
planning_attempts_per_trajectory = Slider(4, range=0..10)
planner_segment_egress_to_place_egress = RemoteSender(list)
allowed_planning_time_per_traj = RemoteSender(allowed_planning_time_per_trajectory)
planning_attempts_per_traj = RemoteSender(planning_attempts_per_trajectory)

allowed_planning_time_per_traj_2 = RemoteReceiver(allowed_planning_time_per_traj)
planning_attempts_per_traj_2 = RemoteReceiver(planning_attempts_per_traj)

# ----
# Calculate IK for place egress planes
ik_attempts = Slider(20, range=0..3000)
joint_position_tolerance_for_ik_in_degre = Slider(5, range=1..30)  # "Joint position tolerance for IK in degrees"
travel_joint_tolerance = RemoteSender(joint_position_tolerance_for_ik_in_degre)

list_2 = ValueList({"Plan for all": 0, "Plan for non-placed": 1, "Manual index selection": 2}, selected="Manual index selection")
end_index = Slider(150, range=0..1000)
path = FilePath("G:\My Drive\abm\biomimetic-fabrication-clay-3dp-bf3dp\production\fab_data\latest.json")
start_index = Slider(0, range=0..1000)
panel_4 = Panel(path)

dam = DataDam(DataA=start_index, DataB=end_index, BufferDelay=10000000, BufferMode=0)  # -> DataA, DataB

end_idx = RemoteSender(dam.DataB)
start_idx = RemoteSender(dam.DataA)

read_fabricationelements_from_json = GhPythonScript(path=path)  # -> out, fabrication_elements, rcf
# ---------- read_fabricationelements_from_json: Python ----------
import json

from compas.geometry import Frame
from compas.data import json_load
from compas_rhino.conversions import frame_to_rhino_plane

from bf3dp_fab.fabrication_element import FabricationElement

class DummyClass(object):
    def __init__(self, data):
        self.data = data

if not path:
    raise Exception("No path given.")

run_data = json_load(path)

fabrication_elements = run_data["fabrication_elements"]

rcf = run_data["rcf"]
rcf_plane = frame_to_rhino_plane(rcf)

run_data = DummyClass(run_data) # Change object to class because dicts are weird in GH
# ---------- end read_fabricationelements_from_json ----------

python_3 = GhPythonScript(fab_data=read_fabricationelements_from_json.fabrication_elements)  # -> out, not_placed_idx; inputs fab_data: list
# ---------- python_3: Python ----------
not_placed_idx = []
for i, elem in enumerate(fab_data):
    if not elem.placed_isotimestamp:
        not_placed_idx.append(i)
# ---------- end python_3 ----------
lng = ListLength(List=read_fabricationelements_from_json.fabrication_elements)
end_idx_2 = RemoteReceiver(end_idx)
start_idx_2 = RemoteReceiver(start_idx)
series = Series(Start=0, Step=1, Count=lng)
dom = ConstructDomain(DomainStart=start_idx_2, DomainEnd=end_idx_2)
subset = SubList(List=series, Domain=dom, Wrap=False)  # -> List, Index
filter = StreamFilter(Gate=list_2, Stream0=series, Stream1=python_3.not_placed_idx, Stream2=subset.List)
difference = SetDifference(SetA=series, SetB=filter)
cull_i = CullIndex(List=read_fabricationelements_from_json.fabrication_elements, Indices=difference, Wrap=False)
cull_i_2 = CullIndex(List=read_fabricationelements_from_json.fabrication_elements, Indices=filter, Wrap=False)
skipped_elems = RemoteSender(cull_i_2)

cull_index = CullIndex(List=cull_i, Indices=data, Wrap=True)
python_4 = GhPythonScript(fabrication_elements_mm=cull_index, scale_mm_to_m=Toggle(True))  # -> out, fabrication_elements_m; inputs fabrication_elements_mm: list
# ---------- python_4: Python ----------
from compas.geometry import Scale

S = Scale.from_factors([.001] * 3)

if scale_mm_to_m:
    fabrication_elements_m = [elem.transformed(S) for elem in fabrication_elements_mm]
else:
    fabrication_elements_m = fabrication_elements_mm
# ---------- end python_4 ----------
python_5 = GhPythonScript(fabrication_elements=python_4.fabrication_elements_m, translation_vector=construct_point)  # -> out, fabrication_elements_trans; inputs fabrication_elements: list
# ---------- python_5: Python ----------
from compas.geometry import Translation

from compas_rhino.conversions import vector_to_compas

vector = vector_to_compas(translation_vector)

T = Translation.from_vector(vector)

if vector.length != 0:
    fabrication_elements_trans = [elem.transformed(T) for elem in fabrication_elements]
else:
    fabrication_elements_trans = fabrication_elements
# ---------- end python_5 ----------

# ----
# Orient frames
python_6 = GhPythonScript(fabrication_elements=python_5.fabrication_elements_trans, rx=radians, ry=radians_2, rz=radians_3)  # -> out, fabrication_elements_rotated; inputs fabrication_elements: list
# ---------- python_6: Python ----------
# don't run if all values are 0
if rx != 0 or ry != 0 or rz != 0:
    fabrication_elements_rotated = [
        elem.rotated_around_self(rx or 0, ry or 0, rz or 0) for elem in fabrication_elements
        ]
else:
    fabrication_elements_rotated = fabrication_elements
# ---------- end python_6 ----------

item = ListItem(List=filter, Index=0, Wrap=True)
larger = LargerThan(FirstNumber=item, SecondNumber=difference)  # -> LargerThan, OrEqualTo

# ----
# Remove earlier trajectories
python_7 = GhPythonScript(to_path_plan=python_6.fabrication_elements_rotated)  # -> out, elems_wo_ppl
# ---------- python_7: Python ----------
from copy import copy

elems_wo_ppl = copy(to_path_plan)

for key in elems_wo_ppl.__dict__.iterkeys():
    if isinstance(key, str) and "trajectory" in key:
        elems_wo_ppl.__dict__[key] = None
# ---------- end python_7 ----------

cull = CullPattern(List=cull_i_2, CullPattern=larger.LargerThan)
read_claybullets_from_json = GhPythonScript(fab_elements=cull, u_res=Slider(6, range=0..100))  # -> out, meshes
# ---------- read_claybullets_from_json: Python ----------
meshes = fab_elements.get_rgmesh(u_res=u_res)
# ---------- end read_claybullets_from_json ----------
transform = Transform(Geometry=read_claybullets_from_json.meshes)

# ---- group: Previously placed cylinders as collision meshes
prev_cylinders_scale_factor_2 = RemoteReceiver(prev_cylinders_scale_factor)
volume = Volume(Geometry=read_claybullets_from_json.meshes)  # -> Volume, Centroid
scale_3 = Scale(Geometry=read_claybullets_from_json.meshes, Center=volume.Centroid, Factor=prev_cylinders_scale_factor_2)  # -> Geometry, Transform

# ----
# Scene
mjoin_2 = MeshJoin()
load_3d_scan_3 = RemoteReceiver(load_3d_scan_2)
number_slider_4 = Slider(0.001, range=0..0.001)
srf = Surface(<surface referenced from the Rhino model>)
mjoin_3 = MeshJoin(Meshes=scale_3.Geometry)
filter_2 = StreamFilter(Gate=load_3d_scan_3, Stream1=mjoin_2)
mesh_4 = Mesh(srf)
scale_4 = Scale(Geometry=mesh_4, Center=Point(0, 0, 0), Factor=number_slider_4)  # -> Geometry, Transform
scale_5 = Scale(Geometry=filter_2, Center=Point(0, 0, 0), Factor=number_slider_4)  # -> Geometry, Transform
boolean_toggle_5 = BooleanToggle(True)
button_2 = Button()
collision_mesh = CollisionMesh(scene=planning_scene, mesh=scale_5.Geometry, identifier="3dscan", remove=boolean_toggle_5)  # -> ok; inputs mesh: Mesh, add: Boolean, append: Boolean, remove: Boolean; disabled
#   port scene: The planning scene.
#   port mesh: A collision mesh.
#   port identifier: The identifier of the collision mesh.
#   port add: If True, adds the collision mesh to the planning scene.
#   port append: If True, appends the collision mesh to the planning scene.
#   port remove: If True, removes the collision mesh from the planning scene.
#   port ok: True if the operation was successfully performed.
# ---------- collision_mesh: Python ----------
"""
Add or remove a collision mesh from the planning scene.

COMPAS FAB v0.28.0
"""
from compas_rhino.geometry import RhinoMesh
from ghpythonlib.componentbase import executingcomponent as component

from compas_fab.robots import CollisionMesh


class CollisionMeshComponent(component):
    def RunScript(self, scene, M, name, add, append, remove):
        ok = False
        self.Message = ""

        if (add and append) or (append and remove) or (add and remove):
            self.Message = "Use only one operation at a time\n(add, append or remove)"
            raise Exception(self.Message)

        if scene and M and name:
            mesh = RhinoMesh.from_geometry(M).to_compas()
            collision_mesh = CollisionMesh(mesh, name)
            if add:
                scene.add_collision_mesh(collision_mesh)
                self.Message = "Added"
                ok = True
            if append:
                scene.append_collision_mesh(collision_mesh)
                self.Message = "Appended"
                ok = True
            if remove:
                scene.remove_collision_mesh(name)
                self.Message = "Removed"
                ok = True
        return ok
# ---------- end collision_mesh ----------
collision_mesh_2 = CollisionMesh(scene=planning_scene, mesh=mjoin_3, identifier="previously_placed", remove=boolean_toggle_5)  # -> ok; inputs mesh: Mesh, add: Boolean, append: Boolean, remove: Boolean; disabled; same code as collision_mesh
collision_mesh_3 = CollisionMesh(scene=planning_scene, mesh=scale_4.Geometry, identifier="print_plate", add=Toggle(True))  # -> ok; inputs mesh: Mesh, add: Boolean, append: Boolean, remove: Boolean; disabled; same code as collision_mesh
panel_5 = Panel(collision_mesh_3)

# ---- group: Transform clay cylinders
# Extract geometry from fabrication elements
python_8 = GhPythonScript(fabrication_elements=python_7.elems_wo_ppl, radius=Slider(0.0035, range=0..10))  # -> out, location_planes, entry_planes, exit_planes, meshes
# ---------- python_8: Python ----------
from compas_rhino.conversions import (frame_to_rhino_plane)

location_planes = frame_to_rhino_plane(fabrication_elements.location_frame)
entry_planes = frame_to_rhino_plane(fabrication_elements.entry_frame)
exit_planes = frame_to_rhino_plane(fabrication_elements.exit_frame)
meshes = fabrication_elements.get_rgmesh(radius)
# ---------- end python_8 ----------

# ----
# Preview planes (Z should b down)
number_slider_5 = Slider(0.002, range=0..100)
cluster = Cluster(plane=flatten(python_8.location_planes), amplitude=number_slider_5, R=Slider(0.001, range=0..10))  # -> geo, color
points = PointList(Points=python_8.location_planes, Size=Slider(4, range=0..100))
preview_2 = CustomPreview(Geometry=cluster.geo, Material=cluster.color)

panel_6 = Panel(python_8.location_planes)
order = PointOrder(Points=python_8.location_planes)
scale_6 = Scale(Geometry=python_8.meshes, Center=python_8.location_planes, Factor=scale_factor_just_placed_cylinders_3)  # -> Geometry, Transform
volume_2 = Volume(Geometry=scale_6.Geometry)  # -> Volume, Centroid
bounding_box = BoundingBox(Content=scale_6.Geometry, Plane=PlaneXY(0, 0, 0))  # -> Box, Box_2
deconstruct_box = DeconstructBox(Box=bounding_box.Box)  # -> Plane, X, Y, Z
scale_7 = Scale(Geometry=python_8.entry_planes, Center=Point(0, 0, 0), Factor=Slider(0.001, range=0..0.001))  # -> Geometry, Transform
ghpython_script = GhPythonScript(mesh=scale_6.Geometry, id="fabrication_element_collision_meshes")  # -> out, collision_mesh
# ---------- ghpython_script: Python ----------
import Rhino.Geometry as rg

from compas_rhino.conversions import RhinoMesh
from compas_fab.robots import CollisionMesh

if isinstance(mesh, rg.Mesh):
    mesh = RhinoMesh.from_geometry(mesh).to_compas()

collision_mesh = CollisionMesh(mesh, id_)
# ---------- end ghpython_script ----------
move = Move(Geometry=scale_7.Geometry, Motion=vector_2pt.Vector)  # -> Geometry, Transform

# ----
# Get inverse kinematics for entry_planes
attempts_per_call = Slider(8, range=1..20)
travel_joint_tolerance_2 = RemoteReceiver(travel_joint_tolerance)
path_constraints_2 = RemoteReceiver(path_constraints)
division = Division(A=ik_attempts, B=attempts_per_call)
round = Round(Number=division)  # -> Nearest, Floor, Ceiling
python_9 = PythonScript(
    robot=attached_tool,
    scene=planning_scene,
    start_conf=forward_kinematics,
    fabrication_elements=python_7.elems_wo_ppl,
    tolerance_joints_deg=travel_joint_tolerance_2,
    ik_constraints=data_2,
    fabrication_element_collision_meshes=ghpython_script.collision_mesh,
    attempt_loops=round.Nearest,
    attempts_per_call=attempts_per_call,
    run=run_ik_for_entry)  # -> out, start_configuration, start_conf_constraint, goal_constraints_sets, goal_configurations, no_IK_idx, start_conf; inputs fabrication_elements: list, ik_constraints: list, fabrication_element_collision_meshes: list, attempt_loops: Int32, attempts_per_call: Int32, run: Boolean
# ---------- python_9: Python ----------
import math

from scriptcontext import sticky as st

from compas_fab.robots import Configuration
from compas_fab.robots import CollisionMesh
from compas_fab.backends import RosValidationError
from compas_fab.backends.ros.messages import MoveItErrorCodes

guid_obj = ghenv.Component.InstanceGuid
guid = str(guid_obj)
if st.get("ppl_components"):
    st["ppl_components"].add(guid_obj)
else:
    st["ppl_components"] = set([guid_obj])

goal_constraints_sets_key = "ppl_pipeline_goal_constraints_sets" + guid
goal_configurations_key = "goal_configurations" + guid
no_IK_idx_key = "no_IK_planes" + guid
start_configuration_key = "start_configuration" + guid
start_conf_constraint_key = "start_conf_constraint" + guid

newly_placed_elements_collision_mesh_id = "newly_placed_elements_collision_mesn"

if not start_conf:
    raise Exception("Need start configuration")

if len(ik_constraints) == 0 or not ik_constraints[0]:
    ik_constraints = None

goal_frames = [elem.entry_frame for elem in fabrication_elements]

# Joint tolerances for goal_constraints
conf_constraint_tolerances = [tolerance_joints_deg] * 6
conf_constraint_tolerances = [math.radians(tol) for tol in conf_constraint_tolerances]
tolerances_above = tolerances_below = conf_constraint_tolerances

if robot and robot.client and robot.client.is_connected:
        scene.remove_collision_mesh(newly_placed_elements_collision_mesh_id)


if robot and robot.client and robot.client.is_connected and run:


    st[goal_configurations_key] = []
    st[goal_constraints_sets_key] = []
    st[no_IK_idx_key] = []

    for i, frame in enumerate(goal_frames):
        if len(st[goal_configurations_key]) > 0:
            start_conf = st[goal_configurations_key][-1]
        for _ in range(attempt_loops):
            try:
                goal_conf = robot.inverse_kinematics(frame,
                                                     start_configuration=start_conf,
                                                     group=group,
                                                     use_attached_tool_frame=True,
                                                     options={
                                                     "attempts": attempts_per_call,
                                                     "constraints": ik_constraints,
                                                     "avoid_collisions": True
                                                     }
                                                     )
            except RosValidationError as e:
                if e.original_exception.error_code == MoveItErrorCodes.NO_IK_SOLUTION:
                    continue
                else:
                    raise
            break
        else:
            goal_conf = None
            st[no_IK_idx_key].append(i)

        st[goal_configurations_key].append(goal_conf)
        
        scene.append_collision_mesh(fabrication_element_collision_meshes[i])



    if len(st[no_IK_idx_key]) == 0:
        for goal_conf in st[goal_configurations_key]:
            goal_constraints = robot.constraints_from_configuration(goal_conf, tolerances_below, tolerances_above, group=group)

            st[goal_constraints_sets_key].append(goal_constraints)

goal_configurations = st.get(goal_configurations_key)
goal_constraints_sets = st.get(goal_constraints_sets_key)
no_IK_idx = st.get(no_IK_idx_key)
start_configuration = st.get(start_configuration_key)
start_conf_constraint = st.get(start_conf_constraint_key)

if goal_constraints_sets:
    print("IK done!")
elif  no_IK_idx and len(no_IK_idx) > 0:
    print("Couldn't find IK for {} frames: {}".format(len(no_IK_idx), no_IK_idx))
else:
    print("Ready to calculate IK!")
# ---------- end python_9 ----------
start_configuration_for_travel = RemoteSender(python_9.start_configuration)
out_ik = RemoteSender(python_9.out)

out_ik_2 = RemoteReceiver(out_ik)
panel_7 = Panel(out_ik_2)

list_item = ListItem(List=move.Geometry, Index=0, Wrap=True)

# ----
# No IK found
list_item_2 = ListItem(List=python_8.location_planes, Index=python_9.no_IK_idx, Wrap=True)
pln_2 = Plane(list_item_2)

clean_tree = CleanTree(RemoveNulls=Toggle(True), RemoveInvalid=True, RemoveEmpty=False, Tree=python_9.goal_configurations)

# ---- group: plan motion
# Plan segment egress to place egress
path_constraints_3 = RemoteReceiver(path_constraints)
main_planning_group_3 = RemoteReceiver(main_planning_group)
planner_segment_egress_to_place_egress_2 = RemoteReceiver(planner_segment_egress_to_place_egress)
plan_motion_2 = PythonScript(
    robot=attached_tool,
    scene=planning_scene,
    group=main_planning_group_3,
    start_configuration=forward_kinematics,
    goal_constraints=python_9.goal_constraints_sets,
    planner_id=planner_segment_egress_to_place_egress_2,
    path_constraints=path_constraints_3,
    new_elem_collision_meshes=ghpython_script.collision_mesh,
    planning_attempts_per_traj=planning_attempts_per_traj_2,
    allowed_planning_time_per_traj=allowed_planning_time_per_traj_2,
    compute=Toggle(True),
    acm=acm_2)  # -> out, start_configurations, trajectories, last_confs, succesful, failed_idx; inputs goal_constraints: list, path_constraints: list, new_elem_collision_meshes: list, acm: list
# ---------- plan_motion_2: Python ----------
from scriptcontext import sticky as st

from compas_fab.robots import PlanningScene
from compas_fab.robots import Configuration
from compas_fab.backends.ros import RosValidationError
from compas_fab.backends.ros.messages import MoveItErrorCodes

guid_obj = ghenv.Component.InstanceGuid
guid = str(guid_obj)
if st.get("ppl_components"):
    st["ppl_components"].add(guid_obj)
else:
    st["ppl_components"] = set([guid_obj])

trajectories_key = "ppl_pipeline_trajectories_" + guid
failed_trajectories_key = "ppl_pipeline_failed_trajectories_" + guid

if len(goal_constraints) == 0 or not goal_constraints[0]:
    raise Exception("Need goal constraints from IK node")

if len(path_constraints) == 0 or not path_constraints[0]:
    path_constraints = None

if robot and robot.client and robot.client.is_connected and scene:
    scene.remove_collision_mesh(new_elem_collision_meshes[0].id)

if (
   robot
   and robot.client
   and robot.client.is_connected
   and start_configuration
   and goal_constraints
   and compute
):
    st[trajectories_key] = []
    st[failed_trajectories_key] = {}
    st[failed_trajectories_key]["PLANNING_FAILED"] = []
    st[failed_trajectories_key]["not_whole_path"] = []
    i = 0
    for constraints, elem_collision_mesh in zip(goal_constraints, new_elem_collision_meshes):
        try:
            trajectory = robot.plan_motion(constraints,
                                           start_configuration=start_configuration,
                                           group=group,
                                           options={ "planner_id": planner_id,
                                                     "num_planning_attempts": planning_attempts_per_traj,
                                                     "allowed_planning_time": allowed_planning_time_per_traj,
                                                     "path_constraints": path_constraints,
                                                     "attached_collision_meshes": list(acm)})
        except RosValidationError as e:
                if e.original_exception.error_code == MoveItErrorCodes.PLANNING_FAILED:
                    st[failed_trajectories_key]["PLANNING_FAILED"].append(i)
                else:
                    raise

        if trajectory.fraction < 1.0:
            st[failed_trajectories_key]["not_whole_path"].append(i)

        st[trajectories_key].append(trajectory)
        scene.append_collision_mesh(elem_collision_mesh, scale=True)
        i += 1

succesful = None
if st.get(failed_trajectories_key):
    failed = False
    for value in st[failed_trajectories_key].values():
        if len(value) > 0:
            succesful = False
            break
    if succesful is False:

        n_planning_failed = len(st[failed_trajectories_key]["PLANNING_FAILED"])
        n_failed_trajs = len(st[failed_trajectories_key]["not_whole_path"])
        print("{} PLANNING_FAILED and {} trajectories with fraction less than one. Failed trajectories: {}".format(n_planning_failed, n_failed_trajs, st[failed_trajectories_key]))
    else:
        succesful = True
else:
    succesful = True

if st.get(failed_trajectories_key):
    failed_idx = list(set(st[failed_trajectories_key]["PLANNING_FAILED"] + st[failed_trajectories_key]["not_whole_path"]))
trajectories = st.get(trajectories_key)

if succesful:
    if trajectories:
        last_confs = [Configuration.from_revolute_values(traj.points[-1].values()) for traj in trajectories]
        print("Planning done!")
    else:
        print("Ready to plan!")
# ---------- end plan_motion_2 ----------
out_travel_to = RemoteSender(plan_motion_2.out)
item_2 = ListItem(List=plan_motion_2.trajectories, Index=Slider(0, range=0..140), Wrap=True)
trajectory_segment_egress_to_place_egres = RemoteSender(plan_motion_2.trajectories)  # "trajectory_segment_egress_to_place_egress"
vis = PythonScript(trajectory=item_2)  # -> P, V, A, time
# ---------- vis: Python ----------
from compas_ghpython import list_to_ghtree

if trajectory:

    positions = []
    velocities = []
    accelerations = []
    time_from_start = []

    for p in trajectory.points:
        positions.append(p.positions)
        velocities.append(p.velocities)
        accelerations.append(p.accelerations)
        time_from_start.append(p.time_from_start.seconds)

    P = list_to_ghtree(list(zip(*positions)))
    V = list_to_ghtree(list(zip(*velocities)))
    A = list_to_ghtree(list(zip(*accelerations)))

    time = time_from_start[-1]
    print time
# ---------- end vis ----------
vis_2 = PythonScript(trajectories=plan_motion_2.trajectories)  # -> cycle_times; inputs trajectories: list
# ---------- vis_2: Python ----------
from compas_ghpython import list_to_ghtree

cycle_times = []
for trajectory in trajectories:
    time = trajectory.points[-1].time_from_start.seconds
    cycle_times.append(time)
    print(time)
# ---------- end vis_2 ----------
prismatic = QuickGraph(vis.P, SortOrder=0)
panel_8 = Panel("positions")
sort = SortList(Keys=vis_2, ValuesA=plan_motion_2.trajectories)  # -> reverse(Keys), reverse(ValuesA)
time_s = Panel(vis.time)
animate = PythonScript(
    robot=attached_tool,
    start_configurations=simplify(plan_motion_2.start_configurations),
    trajectories=simplify(plan_motion_2.trajectories),
    goal_configurations=python_9.goal_configurations)  # -> trajectory_pts_tree; inputs start_configurations: list, trajectories: list, goal_configurations: list
# ---------- animate: Python ----------
from ghpythonlib.treehelpers import list_to_tree

trajectory_pts_list = [trajectory.points for trajectory in trajectories]
print(type(trajectory_pts_list[0][0]))
trajectory_pts_tree = list_to_tree(trajectory_pts_list)
print(trajectory_pts_tree)
"""
if len(full_result) and robot:
    idx = int(map_range(value, 0, 1, 0, len(full_result) - 1))
    configuration = full_result[idx]
"""
# ---------- end animate ----------
graph = QuickGraph(vis.V, SortOrder=0)
graph_2 = QuickGraph(vis.A, SortOrder=0)
panel_9 = Panel("velocities")
panel_10 = Panel("accelerations")

# ----
out_travel_to_2 = RemoteReceiver(out_travel_to)
panel_11 = Panel(out_travel_to_2)

clean_tree_2 = CleanTree(RemoveNulls=boolean_toggle_4, RemoveInvalid=boolean_toggle_4, RemoveEmpty=boolean_toggle_4, Tree=animate)
trajectory_segment_egress_to_place_egres_2 = RemoteReceiver(trajectory_segment_egress_to_place_egres)  # "trajectory_segment_egress_to_place_egress"
skipped_elems_2 = RemoteReceiver(skipped_elems)

# ----
# Settings cartesian moves
path_plan_place_egress_to_uncompressed_t = Button()  # "Path plan place egress to uncompressed top"
path_plan_uncompressed_top_to_compressed = Button()  # "Path plan uncompressed top to compressed top"
first_cartesian_movement_max_step = Slider(5, range=0..200)
second_cartesian_movement_max_step = Slider(5, range=0..200)
second_cartesian_max_step = RemoteSender(second_cartesian_movement_max_step)
first_cartesian_max_step = RemoteSender(first_cartesian_movement_max_step)

first_cartesian_max_step_2 = RemoteReceiver(first_cartesian_max_step)

# ---- group: cartesian motion
# Path plan place egress to uncompressed top
robot_5 = RemoteReceiver(robot)
main_planning_group_4 = RemoteReceiver(main_planning_group)
compute_egress_to_top = RemoteReceiver()
translated_elements = RemoteReceiver()
plan_cartesian_motion = PythonScript(
    robot=robot_5,
    group=main_planning_group_4,
    ready=plan_motion_2.succesful,
    start_confs=plan_motion_2.last_confs,
    elements=simplify(translated_elements),
    max_step=first_cartesian_max_step_2,
    compute=compute_egress_to_top,
    acm=acm_3)  # -> out, trajectories, last_confs; inputs start_confs: list, elements: list, acm: list
# ---------- plan_cartesian_motion: Python ----------
from scriptcontext import sticky as st

from compas_fab.robots import Configuration

guid_obj = ghenv.Component.InstanceGuid
guid = str(guid_obj)
if st.get("ppl_components"):
    st["ppl_components"].add(guid_obj)
else:
    st["ppl_components"] = set([guid_obj])

trajectories_key = "ppl_pipeline_trajectories_" + guid


if not start_confs or len(start_confs) == 0 or not start_confs[0]:
    raise Exception("Need start configuration from previous planner")

if robot and robot.client and robot.client.is_connected and compute:
    st[trajectories_key] = []

    for start_conf, elem in zip(start_confs, elements):
        frame = [elem.get_uncompressed_top_frame()]

        if robot.attached_tool:
            frame = robot.from_attached_tool_to_tool0(frame)

        trajectory = robot.plan_cartesian_motion(frame,
                                                 start_configuration=start_conf,
                                                 max_step=float(max_step),
                                                 avoid_collisions=False,
                                                 group=group,
                                                 attached_collision_meshes=list(acm))

        st[trajectories_key].append(trajectory)

trajectories = st.get(trajectories_key)

if trajectories:
    failed_trajectories = 0
    for i, trajectory in enumerate(trajectories):
        if trajectory and trajectory.fraction < 1.0:
            failed_trajectories += 1
            print("Trajectory idx {} only completeted {} % of its path.".format(i, trajectory.fraction * 100))
    #if failed_trajectories > 0:
        #raise Exception("{} failed trajectories".format(failed_trajectories))
    last_confs = [Configuration.from_revolute_values(traj.points[-1].values) for traj in trajectories]
    print("Planning done!")
else:
    print("Ready to plan!")
# ---------- end plan_cartesian_motion ----------
out_egress_to_top = RemoteSender(plan_cartesian_motion.out)
trajectory_egress_to_top = RemoteSender(plan_cartesian_motion.trajectories)
vis_3 = PythonScript(response=plan_cartesian_motion.trajectories)  # -> P, V, A
# ---------- vis_3: Python ----------
from compas_ghpython import list_to_ghtree

if response:

    positions = []
    velocities = []
    accelerations = []

    for p in response.points:
        positions.append(p.positions)
        velocities.append(p.velocities)
        accelerations.append(p.accelerations)

    P = list_to_ghtree(list(zip(*positions)))
    V = list_to_ghtree(list(zip(*velocities)))
    A = list_to_ghtree(list(zip(*accelerations)))
# ---------- end vis_3 ----------
prismatic_2 = QuickGraph(vis_3.P, SortOrder=0)
robot_6 = RemoteReceiver(robot)
graph_3 = QuickGraph(vis_3.V, SortOrder=0)
graph_4 = QuickGraph(vis_3.A, SortOrder=0)
animate_2 = PythonScript(
    robot=robot_6,
    start_configurations=simplify(plan_motion_2.last_confs),
    trajectories=simplify(plan_cartesian_motion.trajectories))  # -> trajectory_pts; inputs start_configurations: list, trajectories: list
# ---------- animate_2: Python ----------
from ghpythonlib.treehelpers import list_to_tree

from compas_fab.utilities import map_range

from rapid_clay_formations_fab.utils import wrap_list

trajectory_pts = []

for i in range(len(trajectories)):
    _positions = []

    _positions.append(wrap_list(start_configurations, i))
    _positions.extend([p for p in trajectories[i].points if p])

    trajectory_pts.append(_positions)

trajectory_pts = list_to_tree(trajectory_pts)
"""
if len(full_result) and robot:
    idx = int(map_range(value, 0, 1, 0, len(full_result) - 1))
    configuration = full_result[idx]
"""
# ---------- end animate_2 ----------

# ----
second_cartesian_max_step_2 = RemoteReceiver(second_cartesian_max_step)

# ---- group: cartesian motion
# Plan top_to_compressed_top
robot_7 = RemoteReceiver(robot)
tool_w_cylinder = RemoteReceiver()
tool_wo_cylinder = RemoteReceiver()
main_planning_group_5 = RemoteReceiver(main_planning_group)
compute_top_to_compressed = RemoteReceiver()
translated_elements_2 = RemoteReceiver()
plan_cartesian_motion_2 = PythonScript(
    robot=robot_7,
    group=main_planning_group_5,
    start_confs=plan_cartesian_motion.last_confs,
    cylinders=simplify(translated_elements_2),
    max_step=second_cartesian_max_step_2,
    compute=compute_top_to_compressed,
    acm=acm_4,
    tool_w_cylinder=tool_w_cylinder,
    tool_wo_cylinder=tool_wo_cylinder)  # -> out, trajectories, last_confs; inputs start_confs: list, cylinders: list, acm: list
# ---------- plan_cartesian_motion_2: Python ----------
from scriptcontext import sticky as st

from compas_fab.robots import Configuration

guid_obj = ghenv.Component.InstanceGuid
guid = str(guid_obj)
if st.get("ppl_components"):
    st["ppl_components"].add(guid_obj)
else:
    st["ppl_components"] = set([guid_obj])

trajectories_key = "ppl_pipeline_trajectories_" + guid

if len(start_confs) == 0 or not start_confs[0]:
    raise Exception("Need start configuration from previous planner")

if robot.attached_tool and tool_w_cylinder and robot.attached_tool != tool_w_cylinder:
        robot.detach_tool()
        robot.attach_tool(tool_w_cylinder)

if robot and robot.client and robot.client.is_connected and compute:
    st[trajectories_key] = []
    if robot.attached_tool and tool_wo_cylinder and robot.attached_tool != tool_wo_cylinder:
        robot.detach_tool()
        robot.attach_tool(tool_wo_cylinder)

    for start_conf, cylinder in zip(start_confs, cylinders):
        frames = [cylinder.get_compressed_top_frame()]

        if robot.attached_tool:
            frames = robot.from_attached_tool_to_tool0(frames)

        trajectory = robot.plan_cartesian_motion(frames,
                                                 start_configuration=start_conf,
                                                 max_step=float(max_step),
                                                 avoid_collisions=False,
                                                 group=group,
                                                 attached_collision_meshes=list(acm))

        st[trajectories_key].append(trajectory)

trajectories = st.get(trajectories_key)

if trajectories:
    failed_trajectories = 0
    for i, trajectory in enumerate(trajectories):
        if trajectory.fraction < 1.0:
            failed_trajectories += 1
            print("Trajectory idx {} only completeted {} % of its path.".format(i, trajectory.fraction * 100))
    #if failed_trajectories > 0:
        #raise Exception("{} failed trajectories".format(failed_trajectories))
    last_confs = [Configuration.from_revolute_values(traj.points[-1].values) for traj in trajectories]
    print("Planning done!")
else:
    print("Ready to plan!")
# ---------- end plan_cartesian_motion_2 ----------
out_top_to_compressed = RemoteSender(plan_cartesian_motion_2.out)
trajectory_top_to_compressed_top = RemoteSender(plan_cartesian_motion_2.trajectories)
vis_4 = PythonScript(response=plan_cartesian_motion_2.trajectories)  # -> P, V, A; same code as vis_3
prismatic_3 = QuickGraph(vis_4.P, SortOrder=0)
robot_8 = RemoteReceiver(robot)
animate_3 = PythonScript(
    robot=robot_8,
    start_configurations=simplify(plan_cartesian_motion.last_confs),
    trajectories=simplify(plan_cartesian_motion_2.trajectories))  # -> trajectory_pts; inputs start_configurations: list, trajectories: list
# ---------- animate_3: Python ----------
from ghpythonlib.treehelpers import list_to_tree

from rapid_clay_formations_fab.utils import wrap_list

trajectory_pts = []

for i in range(len(trajectories)):
    _positions = []

    _positions.append(wrap_list(start_configurations, i))
    _positions.extend([p for p in trajectories[i].points if p])

    trajectory_pts.append(_positions)

trajectory_pts = list_to_tree(trajectory_pts)
# ---------- end animate_3 ----------
graph_5 = QuickGraph(vis_4.V, SortOrder=0)
graph_6 = QuickGraph(vis_4.A, SortOrder=0)

# ----
out_top_to_compressed_2 = RemoteReceiver(out_top_to_compressed)
out_egress_to_top_2 = RemoteReceiver(out_egress_to_top)
panel_18 = Panel(out_egress_to_top_2)
panel_19 = Panel(out_top_to_compressed_2)

trajectory_egress_to_top_2 = RemoteReceiver(trajectory_egress_to_top)
trajectory_top_to_compressed_top_2 = RemoteReceiver(trajectory_top_to_compressed_top)
python_10 = GhPythonScript(
    robot=robot_2,
    pick_egress_to_segment_egress=trajectory_pick_egress_to_segment_egress,
    segment_egress_to_place_egress=trajectory_segment_egress_to_place_egres_2,
    egress_to_top=trajectory_egress_to_top_2,
    top_to_compressed_top=trajectory_top_to_compressed_top_2,
    elements=python_7.elems_wo_ppl)  # -> out, elements_w_ppl; inputs segment_egress_to_place_egress: list, egress_to_top: list, top_to_compressed_top: list, elements: list
# ---------- python_10: Python ----------
from rapid_clay_formations_fab.robots import MinimalTrajectories
from rapid_clay_formations_fab.robots import MinimalTrajectory

elements_w_ppl = []

for i, elem in enumerate(elements):
    elem_w_ppl = elem.copy()

    elem_w_ppl.travel_trajectories = MinimalTrajectories([])
    
    if pick_egress_to_segment_egress:
        elem_w_ppl.travel_trajectories.append(MinimalTrajectory.from_joint_trajectory(pick_egress_to_segment_egress))
    elem_w_ppl.travel_trajectories.append(MinimalTrajectory.from_joint_trajectory(segment_egress_to_place_egress[i]))

    elem_w_ppl.place_trajectories = MinimalTrajectories([
                                     MinimalTrajectory.from_joint_trajectory(egress_to_top[i]),
                                     MinimalTrajectory.from_joint_trajectory(top_to_compressed_top[i])
                                 ])

    elements_w_ppl.append(elem_w_ppl)
# ---------- end python_10 ----------
item_3 = ListItem(List=python_10.elements_w_ppl, Index=0, Wrap=True)
python_11 = GhPythonScript(skipped_elems=skipped_elems_2, elems_w_ppl=python_10.elements_w_ppl)  # -> out, fab_elems; inputs skipped_elems: list, elems_w_ppl: list
# ---------- python_11: Python ----------
fab_elems = skipped_elems + elems_w_ppl

fab_elems.sort(key=lambda x: x.id_)
for elem in fab_elems:
    for key, value in elem.__dict__.iteritems():
        if isinstance(key, str) and key.startswith("trajectory"):
            if not value or len(value) == 0:
                print("id: {} No trajectory for {}".format(elem.id_, key))
# ---------- end python_11 ----------
python_12 = GhPythonScript(new_fab_data=simplify(python_11.fab_elems), input_file_path=input_json_path, save=save_ppl_json)  # -> out; inputs new_fab_data: list, save: Boolean
# ---------- python_12: Python ----------
import json
import os
from time import strftime
from time import localtime

import System

from rapid_clay_formations_fab.utils import CompasObjEncoder

if old_run_data is None:
    raise Exception("No run_data specified.")

run_data = old_run_data.data

if new_fab_data:
    run_data["fab_data"] = new_fab_data

if new_xform:
    run_data["xform"] = new_xform

if new_conf_path:
    run_data["conf_path"] = new_conf_path

if new_pick_conf:
    run_data["pick_conf"] = new_pick_conf

date_stamp_format = "%Y%m%d-%H.%M.%S"
timestamp = strftime(date_stamp_format, localtime())

run_data["last_modified"] = timestamp

run_data["last_hostname"] = System.Net.Dns.GetHostName()
#print(run_data["fab_data"][0].trajectory_to.points[-1].time_from_start.nsecs)

input_dir, input_basename = os.path.split(input_file_path)
input_dir = r"G:\Shared drives\2020_MAS\T2_P1_BuildingWorkshop\02_robot_control\03_rundata"
new_basename = input_basename.replace(".json", "-with-ppl.json")
new_file_path = os.path.join(input_dir, new_basename)

if save:
    with open(new_file_path, mode='w') as fp:
        json.dump(run_data, fp, cls=CompasObjEncoder)

print(new_file_path)
# ---------- end python_12 ----------
out_save_ppl_json = RemoteSender(python_12)

save_json_with_trajectories = Button()
out_save_ppl_json_2 = RemoteReceiver(out_save_ppl_json)
panel_20 = Panel(out_save_ppl_json_2)

dam_2 = DataDam(DataA=python_10.elements_w_ppl, BufferDelay=10000000, BufferMode=0)
animate_4 = PythonScript(robot=robot_3, cylinders_w_ppl=dam_2)  # -> trajectory_pts; inputs cylinders_w_ppl: list
# ---------- animate_4: Python ----------
from ghpythonlib.treehelpers import list_to_tree

trajectory_pts = []

for cylinder in cylinders_w_ppl:
    _positions = []

    # pick_egress_to_segment_egress
    _positions.extend(cylinder.trajectory_pick_egress_to_segment_egress.points)

    # segment_egress_to_place_egress
    _positions.extend(cylinder.trajectory_segment_egress_to_place_egress.points)

    # egress_to_top
    _positions.extend(cylinder.trajectory_egress_to_top.points)

    # top_to_compressed_top
    _positions.extend(cylinder.trajectory_top_to_compressed_top.points)

    # compressed_top_to_top
    _positions.extend(cylinder.trajectory_compressed_top_to_top.points)

    # top_to_egress
    _positions.extend(cylinder.trajectory_top_to_egress.points)

    # cylinder egress to segment egress
    _positions.extend(cylinder.trajectory_place_egress_to_segment_egress.points)

    # segment egress to pick egress
    _positions.extend(cylinder.trajectory_segment_egress_to_pick_egress.points)

    trajectory_pts.append(_positions)

trajectory_pts = list_to_tree(trajectory_pts)
# ---------- end animate_4 ----------
dam_3 = DataDam(DataA=animate_4, DataB=robot_3, BufferDelay=10000000, BufferMode=0)  # -> DataA, DataB
python_13 = GhPythonScript(robot=dam_3.DataB, configurations=dam_3.DataA)  # -> out, pts
# ---------- python_13: Python ----------
from rapid_clay_formations_fab.rhino import cgframe_to_rgplane

if robot and robot.client and robot.client.is_connected:
    frames = robot.forward_kinematics(configurations)
    pts = cgframe_to_rgplane(frames).Origin
# ---------- end python_13 ----------
pline = PolyLine(Vertices=python_13.pts, Closed=False)

# ----
# Visualization
list_3 = ValueList({"0 forward_kinematics": 0, "1 inverse_kinematics": 1, "2 IK_list": 2, "3 travel_to": 3, "4 egress_to_top": 4, "5 top_to_uncompressed_top": 5, "6 whole_paths": 6}, selected="3 travel_to")
show_end_effector_frame = BooleanToggle(True)
filter_3 = StreamFilter(
    Gate=list_3,
    Stream0=forward_kinematics_2,
    Stream2=clean_tree,
    Stream3=clean_tree_2,
    Stream4=animate_2,
    Stream5=animate_3,
    Stream6=animate_4)
show_base_frame = BooleanToggle(False)
show_collision = BooleanToggle(True)
show_frames = BooleanToggle(True)
show_visual = BooleanToggle(True)
geo_3 = Geometry()
geo_4 = Geometry()  # disabled
geo_5 = Geometry()  # disabled

tstat = TreeStatistics(Tree=filter_3)  # -> Paths, Length, Count
lng_2 = ListLength(List=flatten(tstat.Paths))  # -> expr("x-1", Length)
remap = RemapNumbers(Value=Slider(0.416511, range=0..1), Source=Domain(0, 1), Target=lng_2)  # -> Mapped, Clipped
item_4 = ListItem(List=flatten(tstat.Paths), Index=remap.Mapped, Wrap=True)

panel_21 = Panel(filter_3)
branch = TreeBranch(Tree=filter_3, Path=item_4, MaintainPaths=True)

lng_3 = ListLength(List=flatten(branch))  # -> expr("x-1", Length)
remap_2 = RemapNumbers(Value=Slider(0.49733, range=0..1), Source=Domain(0, 1), Target=lng_3)  # -> Mapped, Clipped
item_5 = ListItem(List=flatten(branch), Index=remap_2.Mapped, Wrap=True)

robot_visualize_2 = RobotVisualize(
    robot=attached_tool,
    configuration=item_5,
    show_visual=show_visual,
    show_collision=show_collision,
    show_frames=show_frames,
    show_base_frame=show_base_frame,
    show_end_effector_frame=show_end_effector_frame,
    show_cm=boolean_toggle_2)  # -> visual, collision, collision_meshes, attached_meshes, frames, base_frame, ee_frame; inputs show_visual: Boolean, show_collision: Boolean, show_frames: Boolean, show_base_frame: Boolean, show_end_effector_frame: Boolean, show_cm: Boolean, show_acm: Boolean; same code as robot_visualize
plane = Plane(robot_visualize_2.ee_frame)
geo_6 = Geometry(robot_visualize_2.collision_meshes)
geo_7 = Geometry(robot_visualize_2.collision)
preview_3 = CustomPreview(Geometry=[geo_7, geo_6])

# ==== cluster Cluster
plane = ClusterInput()
amplitude = ClusterInput()
R = ClusterInput()
deconstruct_plane = DeconstructPlane(Plane=graft(plane))  # -> Origin, XAxis, YAxis, ZAxis
amplitude_2 = Amplitude(Vector=deconstruct_plane.XAxis, Amplitude=amplitude)
amplitude_3 = Amplitude(Vector=deconstruct_plane.YAxis, Amplitude=amplitude)
amplitude_4 = Amplitude(Vector=deconstruct_plane.ZAxis, Amplitude=amplitude)
move = Move(Geometry=deconstruct_plane.Origin, Motion=amplitude_3)  # -> Geometry, Transform
move_2 = Move(Geometry=deconstruct_plane.Origin, Motion=amplitude_4)  # -> Geometry, Transform
move_3 = Move(Geometry=deconstruct_plane.Origin, Motion=amplitude_2)  # -> Geometry, Transform
ln = Line(StartPoint=deconstruct_plane.Origin, EndPoint=move.Geometry)
ln_2 = Line(StartPoint=deconstruct_plane.Origin, EndPoint=move_3.Geometry)
ln_3 = Line(StartPoint=deconstruct_plane.Origin, EndPoint=move_2.Geometry)
pipe = Pipe(Curve=ln, Radius=R, Caps=0)  # -> simplify(Pipe)
pipe_2 = Pipe(Curve=ln_2, Radius=R, Caps=0)  # -> simplify(Pipe)
pipe_3 = Pipe(Curve=ln_3, Radius=R, Caps=0)  # -> simplify(Pipe)
path_mapper = PathMapper(pipe_2, source="{*}", target="{0}")
path_mapper_2 = PathMapper(ColourSwatch(SwatchColor=RGB(255, 0, 0)), source="{*}", target="{0}")
path_mapper_3 = PathMapper(pipe, source="{*}", target="{1}")
path_mapper_4 = PathMapper(ColourSwatch(SwatchColor=RGB(0, 255, 0)), source="{*}", target="{1}")
path_mapper_5 = PathMapper(ColourSwatch(SwatchColor=RGB(0, 0, 255)), source="{*}", target="{2}")
path_mapper_6 = PathMapper(pipe_3, source="{*}", target="{2}")
data = Data([path_mapper_6, path_mapper_3, path_mapper])
data_2 = Data([path_mapper_5, path_mapper_4, path_mapper_2])
geo = ClusterOutput(data)
color = ClusterOutput(data_2)
