# Grasshopper definition slice.ghx (Grasshopper 1.0.7)

cyl = Cylinder(Base=PlaneXY(0, 0, 0), Radius=Slider(150, range=0..1000), Length=Slider(300, range=0..1000))
brep = Brep(cyl)
contour = Contour(Shape=brep, Point=Point(0, 0, 0), Direction=Vector(0, 0, 1), Distance=Slider(5, range=0..10))
divlength = DivideLength(Curve=contour, Length=Slider(5, range=0..10))  # -> Points, Tangents, Parameters
pl = ConstructPlane(Origin=divlength.Points, XAxis=Vector(1, 0, 0), YAxis=Vector(0, 1, 0))
